% Simulink data dictionary TJA_Data.sldd

VOLTAGE_MINIMUM_RANGE = Simulink.Parameter(30, StorageClass="Const", DataType="uint8")
VOLTAGE_MAXIMUM_RANGE = Simulink.Parameter(50, StorageClass="Const", DataType="uint8")
OFF_MODE = Simulink.Parameter(2, StorageClass="Const", DataType="uint8")
ON_MODE = Simulink.Parameter(1, StorageClass="Const", DataType="uint8")
STANDBY_MODE = Simulink.Parameter(3, StorageClass="Const", DataType="uint8")
INTERRUPT_1 = Simulink.Parameter(1, StorageClass="Const", DataType="boolean")
INTERRUPT_2 = Simulink.Parameter(1, StorageClass="Const", DataType="boolean")
NO_DISPLAY = Simulink.Parameter(0, StorageClass="Const", DataType="uint8")
Input_Voltage = Simulink.Signal(StorageClass="ImportedExtern", DataType="uint8")
Input_Switch = Simulink.Signal(StorageClass="ImportedExtern", DataType="boolean")
Enable_Display = Simulink.Signal(StorageClass="ImportedExtern", DataType="uint8")
Output_Display = Simulink.Signal(StorageClass="ExportedGlobal", DataType="uint8")
Optimum_Voltage = Simulink.Signal(DataType="boolean")