# Requirement set untitled (R2025a)

## 1 [Speed Calculation]
The engine speed must be calculated using the formula Speed=100X−50Y+400Speed=100X−50Y+400.

## 2 [Speed Limiting]
If the calculated engine speed is above 3000, limit output to 3000. If below 100, limit to 100. Otherwise, output should be the calculated speed.